# Dynamo graph Import_export sheets.dyn (Dynamo 1.3.3.4111)

# group: Import Sheets
categories = Categories("Sheets")
all_elements_of_category = ElementsOfCategory(categories)
watch = Watch(all_elements_of_category)

# group: Import Parameters
string = StringInput("Sheet Number")
getParameterValueByName = Element.GetParameterValueByName(element=watch, parameterName=string)
string_2 = StringInput("Sheet Name")
getParameterValueByName_2 = Element.GetParameterValueByName(element=watch, parameterName=string_2)

# group: Create List
create = List.Create(getParameterValueByName, getParameterValueByName_2)
transpose = List.Transpose(create)

# group: Write to Excel
file_path = Filename("C:\Users\barkin\Desktop\test.xlsx")
string_3 = StringInput("Sheet1")
number = DoubleInput(0)
number_2 = DoubleInput(0)
writeToFile = Excel.WriteToFile(filePath=file_path, sheetName=string_3, startRow=number, startCol=number_2)  # unwired: data

string_4 = StringInput("Sheet Number")

# group: Import data
fromPath = FileObject(file_path)  # "File.FromPath"
readFromFile = Excel.ReadFromFile(file=fromPath, sheetName=string_3)
transpose_2 = List.Transpose(readFromFile)

string_5 = StringInput("Sheet Name")

# group: Set Parameters
number_3 = DoubleInput(0)
getItemAtIndex = List.GetItemAtIndex(list=transpose_2, index=number_3)
setParameterByName = Element.SetParameterByName(element=all_elements_of_category, parameterName=string_4, value=getItemAtIndex)
number_4 = DoubleInput(1)
getItemAtIndex_2 = List.GetItemAtIndex(list=transpose_2, index=number_4)
setParameterByName_2 = Element.SetParameterByName(element=all_elements_of_category, parameterName=string_5, value=getItemAtIndex_2)
